# Grasshopper definition image_rgb_space.gh (Grasshopper 1.0.7)

point_number_on_longest_side_resolution = Panel("50")
# I made this component as it saves memory by not actually having to load/preview image to get its dimensions.
panel = Panel("C:\Users\ericsonm\OneDrive - Woodbury University\Students_Share\Arch_431_2023\Arch_431_Class_Folder\Repository\Lossy_2023\01_26\web_mountains_small.jpg")
z_scale = Panel("1")
get_image_dims = GhPythonScript(path=panel)  # -> width, height, max_value
# ---------- get_image_dims: Python ----------
__author__ = "erics"
__version__ = "2022.09.15"

import rhinoscriptsyntax as rs
import System

img = System.Drawing.Bitmap.FromFile(path)

width = img.Width
height = img.Height

max_value = max([width,height])
# ---------- end get_image_dims ----------

# ---- group: remap numbers to enable scaling resolution
construct_domain = ConstructDomain(DomainStart="0", DomainEnd=get_image_dims.max_value)
construct_domain_2 = ConstructDomain(DomainStart="0", DomainEnd=point_number_on_longest_side_resolution)
remap_numbers = RemapNumbers(Value=get_image_dims.width, Source=construct_domain, Target=construct_domain_2)  # -> Mapped, Clipped
remap_numbers_2 = RemapNumbers(Value=get_image_dims.height, Source=construct_domain, Target=construct_domain_2)  # -> Mapped, Clipped

# ---- group: create surface
plane_surface = PlaneSurface(Plane=PlaneXY(0, 0, 0), XSize=get_image_dims.width, YSize=get_image_dims.height)
divide_surface = DivideSurface(Surface=plane_surface, UCount=remap_numbers.Mapped, VCount=remap_numbers_2.Mapped)  # -> flatten(Points), Normals, Parameters

# ---- group: Get R,G,B values at each point
image_sampler = ImageSampler(
    divide_surface.Points,
    FilePath="C:\Users\ericsonm\OneDrive - Woodbury University\Students_Share\Arch_CSMA_Catalog\Submissions\davis\image_analysis\web_mountains_small.jpg",
    Filter="Colour",
    Interpolate=True,
    Umax=626,
    Umin=1,
    Vmax=418,
    Vmin=1,
    Wrap=1)
panel_2 = Panel(image_sampler)
deconstruct_vector = DeconstructVector(Vector=panel_2)  # -> XComponent, YComponent, ZComponent

# ----
shift_value = Panel("+1")
addition = Addition(A=remap_numbers_2.Mapped, B=shift_value)
colour_rgb = ColourRGB(Alpha=255, Red=deconstruct_vector.XComponent, Green=deconstruct_vector.YComponent, Blue=deconstruct_vector.ZComponent)

# ---- group: Move points in Z direction
multiplication = Multiplication(A=deconstruct_vector.ZComponent, B=z_scale)
unit_z = UnitZ(Factor=multiplication)
move = Move(Geometry=divide_surface.Points, Motion=unit_z)  # -> Geometry, Transform

# ---- group: Draw sections
partition_list = PartitionList(List=move.Geometry, Size=addition)
deconstruct = Deconstruct(Point=partition_list)  # -> XComponent, YComponent, ZComponent
sort_list = SortList(Keys=deconstruct.YComponent, ValuesValuesA=partition_list)  # -> Keys, ValuesValuesA
polyline = PolyLine(Vertices=sort_list.ValuesValuesA, Closed=False)
explode = Explode(Curve=polyline, Recursive=True)  # -> Segments, Vertices

# ----
multiplication_2 = Multiplication(A=unit_z, B=".1")
circle_cnr = CircleCNR(Center=move.Geometry, Normal=Vector(0, 0, 1), Radius=multiplication_2)
custom_preview = CustomPreview(Geometry=[move.Geometry, circle_cnr], Material=colour_rgb)
custom_preview_2 = CustomPreview(Geometry=explode.Segments, Material=colour_rgb)
