# Grasshopper definition polygon_listener.gh (Grasshopper 1.0.7)
# plug-ins: Firefly_X, Human UI

panel = Panel("""255,100,100
100,255,100
100,100,255""")
panel_2 = Panel("""255,100,100
100,255,100
100,100,255""")
frequency_spectrum = FrequencySpectrum()  # -> NoteVolume, PeakFrequency, PeakNote
create_color_picker = CreateColorPicker(DefaultColor="0,0,0", AvailableColors=panel)
create_color_picker_2 = CreateColorPicker(DefaultColor="0,0,0", AvailableColors=panel_2)
panel_3 = Panel(frequency_spectrum.PeakFrequency)
create_slider = CreateSlider(Slider=Slider(3, range=3..100), ShowBounds=False, ShowTicks=False, ShowTooltip=False, ShowValLabel=True, showLabel=True)
multiplication = Multiplication(A=frequency_spectrum.NoteVolume, B="10000000000000")
value_listener = ValueListener(Elements=create_slider, SomeProperty=True)  # -> Values, Indices
value_listener_2 = ValueListener(Elements=create_color_picker_2, SomeProperty=True)  # -> Values, Indices
division = Division(A=panel_3, B="1000")
addition = Addition(A=multiplication, B="1")
panel_4 = Panel(division)
launch_window = LaunchWindow(Show=Toggle(True), Name="audio_color", Width="400", Height="400", ChildStatus=0, EnableHorizScroll=False)
value_listener_3 = ValueListener(Elements=create_color_picker, SomeProperty=True)  # -> Values, Indices
integer = Integer(panel_4)
addition_2 = Addition(A=integer, B=value_listener.Values)
polygon = Polygon(Plane=PlaneXY(0, 0, 0), Radius=addition, Segments=addition_2, FilletRadius=0)  # -> Polygon, Length
merge = Merge(Data1=create_slider, Data2=create_color_picker, Data3=create_color_picker_2)
add_elements = AddElements(Window=launch_window, Elements=flatten(merge), DoVLChecking=True)  # -> AddedElements, ElementNames

# ---- group: color_list
list_length = ListLength(List=polygon.Polygon)
division_2 = Division(A="1", B=list_length)
series = Series(Start=0, Step=division_2, Count=list_length)

# ----
linear_color = Linear_color(alpha="255", color_1=value_listener_3.Values, color_2=value_listener_2.Values, percentage=series)  # -> colour, r_2, g_2, b_2
custom_preview = CustomPreview(Geometry=polygon.Polygon, Material=linear_color.colour)

# ==== cluster Linear_color
color_1 = ClusterInput()
color_2 = ClusterInput()
percentage = ClusterInput()
alpha = ClusterInput()
alpha_2 = Number(alpha)
color_1_2 = Data(color_1)
color_2_2 = Data(color_2)
percentage_2 = Number(percentage)
panel = Panel(color_1_2)
panel_2 = Panel(color_2_2)
vector_2pt = Vector2Pt(PointA=panel, PointB=panel_2, Unitize=False)  # -> Vector, Length
multiplication = Multiplication(A=vector_2pt.Length, B=percentage_2)
amplitude = Amplitude(Vector=vector_2pt.Vector, Amplitude=multiplication)
move = Move(Geometry=panel, Motion=amplitude)  # -> Geometry, Transform
deconstruct = Deconstruct(Point=move.Geometry)  # -> XComponent, YComponent, ZComponent
b = Number(deconstruct.ZComponent)
r = Number(deconstruct.XComponent)
g = Number(deconstruct.YComponent)
colour_rgb = ColourRGB(Alpha=alpha_2, Red=deconstruct.XComponent, Green=deconstruct.YComponent, Blue=deconstruct.ZComponent)
r_2 = ClusterOutput(r)
g_2 = ClusterOutput(g)
b_2 = ClusterOutput(b)
colour = ClusterOutput(colour_rgb)
