# Grasshopper definition csv_read.gh (Grasshopper 1.0.7)
# plug-ins: LunchBox

panel = Panel("C:\Users\ericsonm\OneDrive - Woodbury University\Students_Share\Arch_431_2023\Arch_431_Class_Folder\Repository\Lossy_2023\01_30\cube.csv")
read_file = ReadFile(File=panel, PerLineParse=True)
read_csv = ReadCSV(CSVString=read_file, Delimiter=",")  # -> Headers, Values
project_options = Panel(read_file)
explode_tree = ExplodeTree(Data=read_csv.Values)  # -> Branch0, Branch1, Branch2
construct_point = ConstructPoint(XCoordinate=explode_tree.Branch0, YCoordinate=explode_tree.Branch1, ZCoordinate=explode_tree.Branch2)
sort_list = SortList(Keys=explode_tree.Branch2, ValuesA=construct_point)  # -> Keys, ValuesA
sort_list_2 = SortList(Keys=explode_tree.Branch1, ValuesValuesA=construct_point)  # -> Keys, ValuesValuesA
partition_list = PartitionList(List=sort_list.ValuesA, Size="4")
partition_list_2 = PartitionList(List=sort_list_2.ValuesValuesA, Size="4")
polyline = PolyLine(Vertices=partition_list, Closed=Toggle(True))
polyline_2 = PolyLine(Vertices=partition_list_2, Closed=Toggle(True))
