# Grasshopper definition csv_reader_ghpython.gh (Grasshopper 1.0.7)

panel = Panel("C:\Users\ericsonm\OneDrive - Woodbury University\Students_Share\Arch_431_2023\Arch_431_Class_Folder\Repository\Lossy_2023\01_30\cube.csv")
ghpython_script = GhPythonScript(file_path=panel)  # -> points
# ---------- ghpython_script: Python ----------
__author__ = "ericsonm"
__version__ = "2023.01.30"

import csv
import rhinoscriptsyntax as rs


#source: https://developer.rhino3d.com/guides/rhinopython/python-csv-file/
#source: https://www.geeksforgeeks.org/reading-csv-files-in-python/


with open(file_path, mode = 'r') as file:
    
    csv_file = csv.reader(file)
    points = []
    for line in csv_file:

        try:
            x = float(line[0])
            y = float(line[1])
            z = float(line[2])
            point = rs.AddPoint(x,y,z)
            points.append(point)
            
        except:
            pass
# ---------- end ghpython_script ----------
deconstruct = Deconstruct(Point=ghpython_script)  # -> XComponent, YComponent, ZComponent
sort_list = SortList(Keys=deconstruct.ZComponent, ValuesValuesA=ghpython_script)  # -> Keys, ValuesValuesA
sort_list_2 = SortList(Keys=deconstruct.YComponent, ValuesValuesA=ghpython_script)  # -> Keys, ValuesValuesA
partition_list = PartitionList(List=sort_list_2.ValuesValuesA, Size="4")
partition_list_2 = PartitionList(List=sort_list.ValuesValuesA, Size="4")
polyline = PolyLine(Vertices=partition_list, Closed=Toggle(True))
polyline_2 = PolyLine(Vertices=partition_list_2, Closed=Toggle(True))
