# Grasshopper definition ghowl_connect.gh (Grasshopper 1.0.7)
# plug-ins: gHowl

# ---- group: connection
get_local_ip_address = GhPythonScript()  # -> ip_address
# ---------- get_local_ip_address: Python ----------
__author__ = "ericsonm"
__version__ = "2023.01.30"

import socket
import time
import rhinoscriptsyntax as rs


sock = socket.socket(socket.AF_INET, socket.SOCK_STREAM)

local_hostname = socket.gethostname()
ip_address = socket.gethostbyname(local_hostname)
# ---------- end get_local_ip_address ----------
udp_receiver = UDPReceiver(Address=get_local_ip_address, Port="23456", Pattern="0")  # -> Info, Data
panel = Panel(udp_receiver.Data)
panel_2 = Panel(udp_receiver.Info)

# ---- group: dummy operation
radians = Radians(Degrees=panel)
cosine = Cosine(Value=radians)
sine = Sine(Value=radians)
multiplication = Multiplication(A=cosine, B="50")
multiplication_2 = Multiplication(A="50", B=sine)
construct_point = ConstructPoint(XCoordinate=multiplication, YCoordinate=multiplication_2, ZCoordinate=0)
