# Grasshopper definition ghowl_connect_hands.gh (Grasshopper 1.0.7)
# plug-ins: gHowl

# ---- group: connection
get_local_ip_address = GhPythonScript()  # -> ip_address
# ---------- get_local_ip_address: Python ----------
__author__ = "ericsonm"
__version__ = "2023.01.30"

import socket
import time
import rhinoscriptsyntax as rs


sock = socket.socket(socket.AF_INET, socket.SOCK_STREAM)

local_hostname = socket.gethostname()
ip_address = socket.gethostbyname(local_hostname)
# ---------- end get_local_ip_address ----------
udp_receiver = UDPReceiver(Address=get_local_ip_address, Port="23456", Pattern="0")  # -> Info, Data
panel = Panel(udp_receiver.Data)
panel_2 = Panel(udp_receiver.Info)

# ----
xz_plane = XZPlane(Origin=Point(0, 0, 0))
string_to_points = GhPythonScript(string=panel)  # -> points
# ---------- string_to_points: Python ----------
__author__ = "erics"
__version__ = "2023.02.08"

import rhinoscriptsyntax as rs

list = eval(string)

print(list)

points = rs.AddPoints(list)

print(points)
# ---------- end string_to_points ----------
yz_plane = YZPlane(Origin=Point(0, 0, 0))
mirror = Mirror(Geometry=string_to_points, Plane=xz_plane)  # -> Geometry, Transform
mirror_2 = Mirror(Geometry=mirror.Geometry, Plane=yz_plane)  # -> Geometry, Transform
ghpython_script = GhPythonScript(points=string_to_points, minimum=Slider(0, range=0..1000), maximum=Slider(229, range=0..1000))  # -> color; inputs points: list
# ---------- ghpython_script: Python ----------
__author__ = "erics"
__version__ = "2023.02.08"

import rhinoscriptsyntax as rs

def remap(value, source_min, source_max, target_min, target_max):
    source = source_max - source_min
    target = target_max - target_min
    value_less = value - source_min
    
    new_value = (target * value_less / source) + target_min
    return new_value
    
def clamp(value, floor, ceiling):
    if value < floor:
        return floor
    if value > ceiling:
        return ceiling
    else:
        return value

def point_to_rgb(point, min, max):
    
    x, y, z = point
    
    r = clamp(remap(x, min, max, 0, 200), 0, 200)
    g = clamp(remap(y, min, max, 0, 200), 0, 200)
    b = clamp(remap(z, min, max, 0, 200), 0, 200)
    
    return r, g, b

for point in points:
    if rs.IsPoint(point) == True:
        x, y, z = rs.PointCoordinates(point)
        r, g, b = point_to_rgb((x, y,z), minimum, maximum)

        color = rs.CreateColor(r, g, b)
# ---------- end ghpython_script ----------

partition_list = PartitionList(List=mirror_2.Geometry, Size="5")
deconstruct = Deconstruct(Point="12,59,101")  # -> XComponent, YComponent, ZComponent
polyline = PolyLine(Vertices=partition_list, Closed=False)
colour_rgb = ColourRGB(Alpha=255, Red=deconstruct.XComponent, Green=deconstruct.YComponent, Blue=deconstruct.ZComponent)
center_box = CenterBox(Base=partition_list, X="10", Y="10", Z="10")
custom_preview = CustomPreview(Geometry=[polyline, center_box], Material=ghpython_script)
