# Grasshopper definition get_file.gh (Grasshopper 1.0.7)

get_file = GhPythonScript(update=Toggle(False))  # -> file_path
# ---------- get_file: Python ----------
__author__ = "erics"
__version__ = "2023.02.01"



import rhinoscriptsyntax as rs


if update:
    file_name = rs.OpenFileName()
    print (file_name)
    file_path = file_name
    print(file_path)
else:
    file_path = None
# ---------- end get_file ----------
panel = Panel(get_file)
