# Grasshopper definition viewport_tools_example.gh (Grasshopper 1.0.7)
# plug-ins: Human

# ---- group: Main Script
circle = Circle(Plane=PlaneXY(0, 0, 0), Radius="60")
colour_rgb = ColourRGB(Alpha=255, Red="0", Green="0", Blue="0")
custom_preview_lineweights = CustomPreviewLineweights(Geometry=circle, Shader=colour_rgb, Absolute=False)

# ---- group: Create and Save Viewport
# Remove the xyz icon and grid from your page
button = Button()
# Create a viewport in pixel dimensions.
# Provide a name.
# Provide a case specific Rhino Projection
# (Top, Front, Side, Perspective...)
# Set the case specific Rhino Display Mode.
# (Rendered, Ghosted, Wireframe...)
panel = Panel("circle_draw")
# Create a folder on the users desktop.
panel_2 = Panel("Mark")
create_folder = GhPythonScript(create_folder=Toggle(True), folder_name=panel_2)  # -> folder_path; inputs create_folder: Boolean
# ---------- create_folder: Python ----------
__author__ = "erics"
__version__ = "2022.11.17"

import rhinoscriptsyntax as rs
import System


if folder_name:
    folder = System.Environment.SpecialFolder.Desktop
    path = System.Environment.GetFolderPath(folder)
    directory = System.IO.Path.Combine(path, folder_name)
if create_folder:
    System.IO.Directory.CreateDirectory(directory)
    folder_path = directory
# ---------- end create_folder ----------
# Delete Viewport manually
#  in Rhino if you want to
#  change scale, display mode,
#  projection or
# other viewport property.
create_viewport = GhPythonScript(create_viewport=Button(), width="600", height="600", view_name=panel, projection="Top", display_mode="wireFrame")  # inputs create_viewport: Boolean, width: Int32, height: Int32
# ---------- create_viewport: Python ----------
from ghpythonlib.componentbase import executingcomponent as component
import Grasshopper, GhPython
import System
import Rhino
import rhinoscriptsyntax as rs
import scriptcontext as sc

class MyComponent(component):
    
    def RunScript(self, create_viewport, width, height, view_name, projection, display_mode):
        """Provides a  component to create and control viewport
            Inputs:
                create_viewport:  Boolean to create viewport
                width: Width of viewport
                height:  Height of viewport
                view_name: Name of new viewport
                display_mode: Sets the display mode
                "Rendered", "Wireframe", "Ghosted", "Shaded", "X-Ray", "Arctic", "Technical", "Artistic", "Pen"
                zoom_extents:  Boolean to zoom window extents
                
                """

        
        __author__ = "erics"
        __version__ = "2022.11.10"
        
        
        def zoom_scale(percentage):
            """
            Zooms the active window by a value
            example:
            zoom_scale(.75)
            """
            command = "Zoom Factor" + " " + str(float(percentage))
            rs.Command(command)

        def set_display_mode(view_name, display_mode="Rendered"):
            """
            Sets the disaplay mode of a specific viewport
            view_name: name of the view
            display_mode: Sets the mode of of display.  If None == "Rendered".  
            "Rendered", "Wireframe", "Ghosted", "Shaded", "X-Ray", "Arctic", "Technical", "Artistic", "Pen"
            example:
            set_display_mode("Top", display_mode="Wireframe")
                """
            rs.EnableRedraw(True)
            viewport = sc.doc.Views.Find(view_name, False).ActiveViewport
            mode = Rhino.Display.DisplayModeDescription.FindByName(display_mode)
            viewport.DisplayMode = mode
            return viewport
        
        def create_parallel_view(view_name, size, projection, display="Rendered"):
            """Creates a new viewport in top, parallel view.
            view_name:  name of view to be added
            size:  Tuple of X and Y dimensions in pixels of the viewport to be created (x_size, y_size)
            display_mode: Sets the mode of of display.  If None == "Rendered".  
            "Rendered", "Wireframe", "Ghosted", "Shaded", "X-Ray", "Arctic", "Technical", "Artistic", "Pen"
            example:
            create_parallel_view("Axo", (800,800), display_mode="Rendered")
            """
            size_x, size_y = size
            method = "Rhino.Display.DefinedViewportProjection." + str(projection)
            view =  eval(method)
            dimensions = System.Drawing.Rectangle(20,20,size_x,size_y)
            sc.doc = Rhino.RhinoDoc.ActiveDoc
            sc.doc.Views.Add(view_name, view, dimensions,True)
            viewport = set_display_mode(view_name, display)
            sc.doc = ghdoc
#main__________________________________________________________________________________________
        if create_viewport:
            if (width and height and display_mode and view_name and projection) != None: 
                viewport = create_parallel_view(view_name, (width, height), projection, display_mode)

        else:pass
# ---------- end create_viewport ----------
remove_grid_axes = GhPythonScript(update=button, view_name=panel)
# ---------- remove_grid_axes: Python ----------
__author__ = "erics"
__version__ = "2022.12.02"

import rhinoscriptsyntax as rs
import scriptcontext as sc
import Rhino




if update:
    viewport = sc.doc.Views.Find(view_name, False).ActiveViewport
    viewport.WorldAxesVisible = False
    viewport.ConstructionGridVisible = False
    viewport.ConstructionAxesVisible = False
# ---------- end remove_grid_axes ----------
# create file name and add to folder path.
panel_3 = Panel(create_folder)
concatenate = Concatenate(FragmentA=panel_3, FragmentB="\circle.png")
set_the_resolution = Panel("5")
# Use this component to fit and center
#  your geometry on your viewport.
# You can also use the scale factor
# to reduce the size of the geometry
# relative to the viewport.
number_slider = Slider(1, range=0..1)
# this component is from Human.
# The scale factor, scales the viewport size
# in pixels.  This setup will produce a
# 1600 x 1600 pixel image.
save_viewport_to_file = SaveViewportToFile(Run=Button(), ViewportName=panel, Render=False, FilePath=concatenate, ScaleFactor=set_the_resolution)
zoom_viewport = GhPythonScript(zoom_extents=Button(), view_name=panel, zoom_factor=number_slider)  # inputs zoom_extents: Boolean
# ---------- zoom_viewport: Python ----------
from ghpythonlib.componentbase import executingcomponent as component
import Grasshopper, GhPython
import System
import Rhino
import rhinoscriptsyntax as rs
import scriptcontext as sc

class MyComponent(component):
    
    def RunScript(self, zoom_extents, view_name, zoom_factor):
        """Sets Zoom scale for specific viewport
            Inputs:
                zoom_extents:  Boolean to zoom extents
                view_name:  Name of view to be scaled.
                zoom_factor:  Factor to scale the zoom"""
        
        
        __author__ = "erics"
        __version__ = "2022.11.10"

        if (zoom_extents and view_name):
            rs.ZoomExtents(view_name)
            if zoom_factor:
                factor = rs.ViewCameraLens() * float(zoom_factor)
                rs.ViewCameraLens(view_name, length=factor)
# ---------- end zoom_viewport ----------
panel_4 = Panel(save_viewport_to_file)
