# Grasshopper definition ghowl_connect_hands_with_cube.gh (Grasshopper 1.0.7)
# plug-ins: gHowl

# ---- group: connection
get_local_ip_address = GhPythonScript()  # -> ip_address
# ---------- get_local_ip_address: Python ----------
__author__ = "ericsonm"
__version__ = "2023.01.30"

import socket
import time
import rhinoscriptsyntax as rs


sock = socket.socket(socket.AF_INET, socket.SOCK_STREAM)

local_hostname = socket.gethostname()
ip_address = socket.gethostbyname(local_hostname)
# ---------- end get_local_ip_address ----------
udp_receiver = UDPReceiver(Address=get_local_ip_address, Port="23456", Pattern="0")  # -> Info, Data
panel = Panel(udp_receiver.Data)
panel_2 = Panel(udp_receiver.Info)

# ---- group: Mirror points to camera
xz_plane = XZPlane(Origin=Point(0, 0, 0))
string_to_points = GhPythonScript(string=panel)  # -> points
# ---------- string_to_points: Python ----------
__author__ = "erics"
__version__ = "2023.02.08"

import rhinoscriptsyntax as rs

list = eval(string)


points = rs.AddPoints(list)
# ---------- end string_to_points ----------
mirror = Mirror(Geometry=string_to_points, Plane=xz_plane)  # -> Geometry, Transform
yz_plane = YZPlane(Origin=Point(0, 0, 0))
mirror_2 = Mirror(Geometry=mirror.Geometry, Plane=yz_plane)  # -> Geometry, Transform

# ----
partition_list = PartitionList(List=mirror_2.Geometry, Size="22")

# ---- group: Hand
partition_list_2 = PartitionList(List=partition_list, Size="4")
point_to_rgb = GhPythonScript(points=string_to_points, minimum=Slider(0, range=0..1000), maximum=Slider(372, range=0..1000))  # -> colors; inputs points: list
# ---------- point_to_rgb: Python ----------
__author__ = "erics"
__version__ = "2023.02.08"

import rhinoscriptsyntax as rs

def remap(value, source_min, source_max, target_min, target_max):
    source = source_max - source_min
    target = target_max - target_min
    value_less = value - source_min
    
    new_value = (target * value_less / source) + target_min
    return new_value
    
def clamp(value, floor, ceiling):
    if value < floor:
        return floor
    if value > ceiling:
        return ceiling
    else:
        return value

def point_to_rgb(point, min, max):
    
    x, y, z = point
    
    r = clamp(remap(x, min, max, 0, 200), min, 255)
    g = clamp(remap(y, min, max, 0, 200), min, 255)
    b = clamp(remap(z, min, max, 0, 200), min, 255)
    
    return r, g, b
colors = []
for point in points:
    if rs.IsPoint(point) == True:
        x, y, z = rs.PointCoordinates(point)
        r, g, b = point_to_rgb((x, y,z), minimum, maximum)

        color = rs.CreateColor(r, g, b)
        colors.append(color)
# ---------- end point_to_rgb ----------
polyline = PolyLine(Vertices=partition_list_2, Closed=False)
center_box = CenterBox(Base=partition_list_2, X="10", Y="10", Z="10")
custom_preview = CustomPreview(Geometry=[polyline, center_box], Material=point_to_rgb)

# ---- group: Interaction Control / Index tip
tree_branch = TreeBranch(Tree=simplify(partition_list_2), Path="1", MaintainPaths=True)
list_item = ListItem(List=flatten(tree_branch), Index="4", Wrap=True)

# ---- group: cubes
multiplication = Multiplication(A="30", B="5")
series = Series(Start=0, Step="30", Count="5")
cross_reference = CrossReference(ListListA=series, ListListB=series, ListA=series, CrossMode=1)  # -> ListListA, ListListB, ListA
construct_point = ConstructPoint(XCoordinate=cross_reference.ListListA, YCoordinate=cross_reference.ListListB, ZCoordinate=cross_reference.ListA)
division = Division(A="30", B="2")
center_box_2 = CenterBox(Base=construct_point, X=division, Y=division, Z=division)
point_to_rgb_2 = GhPythonScript(points=construct_point, minimum=Slider(0, range=0..1000), maximum=multiplication)  # -> colors; inputs points: list; same code as point_to_rgb

# ---- group: Interaction Control / Thumb tip
tree_branch_2 = TreeBranch(Tree=simplify(partition_list_2), Path="2", MaintainPaths=True)

# ---- group: Interaction Control
list_item_2 = ListItem(List=flatten(partition_list_2), Index=0, Wrap=True)
panel_3 = Panel("4")
vector_2pt = Vector2Pt(PointA=list_item_2, PointB=construct_point, Unitize=False)  # -> Vector, Length

# ---- group: Interaction Control / Thumb tip (continued)
list_item_3 = ListItem(List=flatten(tree_branch_2), Index=panel_3, Wrap=True)

# ---- group: Interaction Control (continued)
distance = Distance(PointA=list_item, PointB=list_item_3)
multiplication_2 = Multiplication(A=distance, B="10")
smooth_numbers = SmoothNumbers(Numbers=multiplication_2, SmoothDelay=2000)
amplitude = Amplitude(Vector=vector_2pt.Vector, Amplitude=smooth_numbers)

# ---- group: cubes (continued)
move = Move(Geometry=center_box_2, Motion=amplitude)  # -> Geometry, Transform
custom_preview_2 = CustomPreview(Geometry=move.Geometry, Material=point_to_rgb_2)

# ----
data_recorder = DataRecorder(move.Geometry, DataLimit=-10, RecordData=True)
custom_preview_3 = CustomPreview(Geometry=data_recorder, Material=point_to_rgb_2)
