# Grasshopper definition get_url_file.gh (Grasshopper 1.0.7)
# plug-ins: LunchBox

create_folder = GhPythonScript(create_folder=Toggle(True), folder_name="data")  # -> folder_path; inputs create_folder: Boolean
# ---------- create_folder: Python ----------
__author__ = "erics"
__version__ = "2022.11.17"

import rhinoscriptsyntax as rs
import System


if folder_name:
    folder = System.Environment.SpecialFolder.Desktop
    path = System.Environment.GetFolderPath(folder)
    directory = System.IO.Path.Combine(path, folder_name)
if create_folder:
    System.IO.Directory.CreateDirectory(directory)
    folder_path = directory
# ---------- end create_folder ----------
panel = Panel(create_folder)
panel_2 = Panel("https://raw.githubusercontent.com/datadesk/california-drought-scrapers/main/data/processed/district-level-residential-use.csv")
concatenate = Concatenate(FragmentA=panel, FragmentB="\res")
ghpython_script = GhPythonScript(reset=Button(), url=panel_2, file_path=concatenate, extension=".csv")  # -> file_out; inputs reset: Boolean
# ---------- ghpython_script: Python ----------
__author__ = "ericsonm"
__version__ = "2023.03.09"

import urllib

def creat_file_path(file_path, extension):
    return file_path + extension
def get_url_file(file, url, extension):
    urllib.urlretrieve(url, file)



file_out = creat_file_path(file_path, extension)
if reset:
    get_url_file(file_out, url, extension)
# ---------- end ghpython_script ----------
read_file = ReadFile(File=ghpython_script, PerLineParse=True)
read_csv = ReadCSV(CSVString=read_file, Delimiter=",")  # -> Headers, Values
panel_3 = Panel(read_csv.Headers)
panel_4 = Panel(read_csv.Values)
