# Grasshopper definition circle_points.gh (Grasshopper 1.0.7)
# plug-ins: circle_points

construct_point = ConstructPoint(XCoordinate=0, YCoordinate=0, ZCoordinate=0)
circle_points = GhPythonScript(radius="20", center=construct_point, num_points=Slider(88, range=0..1000))  # -> points; inputs center: Point3d, num_points: Int32
# ---------- circle_points: Python ----------
"""Provides a scripting component.
            Inputs:
                radius: the radius
                center: the center
                num_points: the number of points
            Output:
                points: points"""
                        




from ghpythonlib.componentbase import executingcomponent as component
import Grasshopper, GhPython
import System
import Rhino
import rhinoscriptsyntax as rs
import rhinoscriptsyntax as rs
from math import sin
from math import cos
from math import radians

__author__ = "ericsonm"
__version__ = "2023.04.27"


class MyComponent(component):
    
    def RunScript(self, radius, center, num_points):


        points = None

        def circle_points(center, radius, num_points):
            num = int(num_points)
            c_point = rs.AddPoint(center)
            points = []
            cx, cy, xz = rs.PointCoordinates(c_point)
            for i in range(num_points):
                x = cos(radians(i)) * radius + cx
                y = sin(radians(i)) * radius + cy
                point = rs.AddPoint(x,y,0)
                points.append(point)
            return points
                        
        if (center and radius and num_points):
                        
            points = circle_points(center, radius, num_points)
        
        # return outputs if you have them; here I try it for you:
        return points
# ---------- end circle_points ----------
circle_points_2 = Circle_points()
